test file "regressionTests"

suite "Windows Tests"
  setup callback:
    % Build S-Function
    buildSFun;

  case "Basic Simulink functionality - Send" [baseline]
    model ecal_helloworld_snd, mode Normal, stop time 1
    baseline "baselineResults.mat"
      data_snd

  case "Basic Simulink functionality - Receive" [baseline]
    model ecal_helloworld_rec, mode Normal, stop time 1

suite "SLRT Tests"

  case "Build test - Send" [simulation]
    model ecal_helloworld_snd, mode Normal, stop time 0
    post-load callback:
      rtwbuild(sltest_bdroot,'generateCodeOnly',false);
    custom criteria:
      ecalObj = eCALutils('../_install_qnx');

      test.assertFalse(isempty(ecalObj.ListECALLibFiles));

  case "Build test - Receive" [simulation]
    model ecal_helloworld_rec, mode Normal, stop time 0
    post-load callback:
      rtwbuild(sltest_bdroot,'generateCodeOnly',false);
    custom criteria: same code as in custom criteria of case "Build test - Send"